# Grasshopper definition Curb.gh (Grasshopper 1.0.7)

crb_width = GetNumber(
    Slider(1000, range=1000..5000),
    AtLeast=1,
    AtMost=1,
    Maximum=1.797693135e+308,
    Minimum=-1.797693135e+308,
    TreeAccess=False)
crb_height = GetNumber(Slider(179, range=100..500), AtLeast=1, AtMost=1, Maximum=1.797693135e+308, Minimum=-1.797693135e+308, TreeAccess=False)
crb_length = GetNumber(
    Slider(5046, range=3000..20000),
    AtLeast=1,
    AtMost=1,
    Maximum=1.797693135e+308,
    Minimum=-1.797693135e+308,
    TreeAccess=False)
rectangle = Rectangle(Plane=PlaneXY(0, 0, 0), XSize=crb_length, YSize=crb_width, Radius=0)  # -> Rectangle, Length
boundary = BoundarySurfaces(Edges=rectangle.Rectangle)
Z = UnitZ(Factor=crb_height)
extr = Extrude(Base=boundary, Direction=Z)
rh_out_crb_brep = Brep(extr)
debrep = DeconstructBrep(Brep=extr)  # -> Faces, Edges, Vertices
item = ListItem(List=debrep.Faces, Index=1, Wrap=True)
item_2 = ListItem(List=debrep.Faces, Index=3, Wrap=True)
area = Area(Geometry=item)  # -> Area, Centroid
area_2 = Area(Geometry=item_2)  # -> Area, Centroid
pi = Pi(Factor=1)
pi_2 = Pi(Factor=1)
pl_origin = PlaneOrigin(Base=item, Origin=area.Centroid)
pl_origin_2 = PlaneOrigin(Base=item_2, Origin=area_2.Centroid)
division = Division(A=pi, B="-2")
division_2 = Division(A=pi_2, B="2")
prot = RotatePlane(Plane=pl_origin, Angle=division_2)
prot_2 = RotatePlane(Plane=pl_origin_2, Angle=division)
pflip = FlipPlane(Plane=prot_2, ReverseX=False, ReverseY=False, SwapAxes=True)
rh_out_crb_interface2 = Plane(prot)
rh_out_crb_interface1 = Plane(pflip)
deplane = DeconstructPlane(Plane=rh_out_crb_interface2)  # -> Origin, XAxis, YAxis, ZAxis
deplane_2 = DeconstructPlane(Plane=rh_out_crb_interface1)  # -> Origin, XAxis, YAxis, ZAxis
vdis = VectorDisplay(Anchor=deplane.Origin, Vector=deplane.ZAxis)
vdis_2 = VectorDisplay(Anchor=deplane_2.Origin, Vector=deplane_2.ZAxis)
