# Grasshopper definition Girder.gh (Grasshopper 1.0.7)

number_slider = Slider(5689, range=3000..20000)
number_slider_2 = Slider(3278, range=1000..5000)
vec = VectorXYZ(XComponent=Slider(0, range=0..1000), YComponent=Slider(0, range=0..1000), ZComponent=0)  # -> Vector, Length
xy = XYPlane(Origin=Point(0, 0, 0))
grd_offset1 = GetNumber(Slider(447, range=1..1000), AtLeast=1, AtMost=1, Maximum=1.797693135e+308, Minimum=-1.797693135e+308, TreeAccess=False)
grd_width = GetNumber(number_slider_2, AtLeast=1, AtMost=1, Maximum=1.797693135e+308, Minimum=-1.797693135e+308, TreeAccess=False)
grd_height = GetNumber(Slider(319, range=100..500), AtLeast=1, AtMost=1, Maximum=1.797693135e+308, Minimum=-1.797693135e+308, TreeAccess=False)
grd_length = GetNumber(number_slider, AtLeast=1, AtMost=1, Maximum=1.797693135e+308, Minimum=-1.797693135e+308, TreeAccess=False)
grd_offset2 = GetNumber(Slider(486, range=1..1000), AtLeast=1, AtMost=1, Maximum=1.797693135e+308, Minimum=-1.797693135e+308, TreeAccess=False)
move = Move(Geometry=xy, Motion=vec.Vector)  # -> Geometry, Transform
box = DomainBox(Base=move.Geometry, X=grd_length, Y=grd_width, Z=grd_height)
rad = Radians(Degrees=Slider(360, range=0..360))
rotate = Rotate(Geometry=box, Angle=rad, Plane=move.Geometry)  # -> Geometry, Transform
rh_out_grd_brep = Brep(rotate.Geometry)
deplane = DeconstructPlane(Plane=PlaneXY(0, 0, 0))  # -> Origin, XAxis, YAxis, ZAxis
debrep = DeconstructBrep(Brep=rotate.Geometry)  # -> Faces, Edges, Vertices
item = ListItem(List=debrep.Faces, Index="4", Wrap=True)
item_2 = ListItem(List=debrep.Faces, Index="5", Wrap=True)
pt = ConstructPoint(XCoordinate=0, YCoordinate=grd_width, ZCoordinate=0)
item_3 = ListItem(List=debrep.Vertices, Index=4, Wrap=True)
integer_division = IntegerDivision(A=number_slider, B=2)
integer_division_2 = IntegerDivision(A=number_slider_2, B=2)
deplane_2 = DeconstructPlane(Plane=item)  # -> Origin, XAxis, YAxis, ZAxis
area = Area(Geometry=item)  # -> Area, Centroid
subtraction = Subtraction(A=integer_division, B=grd_offset1)
move_2 = Move(Geometry=item_3, Motion=pt)  # -> Geometry, Transform
subtraction_2 = Subtraction(A=integer_division_2, B=grd_offset2)
multiplication = Multiplication(A=subtraction, B=deplane_2.YAxis)
neg = Negative(Value=multiplication)
move_3 = Move(Geometry=area.Centroid, Motion=neg)  # -> Geometry, Transform
move_4 = Move(Geometry=area.Centroid, Motion=multiplication)  # -> Geometry, Transform
pl_origin = PlaneOrigin(Base=item_2, Origin=move_2.Geometry)
pl_origin_2 = PlaneOrigin(Base=item_2, Origin=item_3)
Y = UnitY(Factor=subtraction_2)
Y_2 = UnitY(Factor=subtraction_2)
multiplication_2 = Multiplication(A=subtraction_2, B=deplane_2.XAxis)
pl_origin_3 = PlaneOrigin(Base=item, Origin=move_4.Geometry)
neg_2 = Negative(Value=multiplication_2)
neg_3 = Negative(Value=Y_2)
pl_origin_4 = PlaneOrigin(Base=move_3.Geometry, Origin=move_3.Geometry)
pflip = FlipPlane(Plane=pl_origin_2, ReverseX=False, ReverseY=False, SwapAxes=True)
pflip_2 = FlipPlane(Plane=pl_origin, ReverseX=False, ReverseY=False, SwapAxes=True)
prot = RotatePlane(Plane=pl_origin_3, Angle=-1.570796327)
move_5 = Move(Geometry=prot, Motion=Y_2)  # -> Geometry, Transform
move_6 = Move(Geometry=prot, Motion=neg_3)  # -> Geometry, Transform
move_7 = Move(Geometry=pl_origin_4, Motion=multiplication_2)  # -> Geometry, Transform
move_8 = Move(Geometry=pl_origin_4, Motion=neg_2)  # -> Geometry, Transform
rh_out_grd_sidewalk_interface1 = Plane(pflip)
rh_out_grd_sidewalk_interface2 = Plane(pflip_2)
rh_out_grd_interface2 = Plane(prot)
rh_out_grd_interface3 = Plane(move_5.Geometry)
rh_out_grd_interface1 = Plane(move_6.Geometry)
rh_out_grd_interface5 = Plane(pl_origin_4)
rh_out_grd_interface6 = Plane(move_7.Geometry)
rh_out_grd_interface4 = Plane(move_8.Geometry)
deplane_3 = DeconstructPlane(Plane=rh_out_grd_sidewalk_interface2)  # -> Origin, XAxis, YAxis, ZAxis
deplane_4 = DeconstructPlane(Plane=rh_out_grd_interface2)  # -> Origin, XAxis, YAxis, ZAxis
deplane_5 = DeconstructPlane(Plane=rh_out_grd_sidewalk_interface1)  # -> Origin, XAxis, YAxis, ZAxis
deplane_6 = DeconstructPlane(Plane=rh_out_grd_interface3)  # -> Origin, XAxis, YAxis, ZAxis
deplane_7 = DeconstructPlane(Plane=rh_out_grd_interface1)  # -> Origin, XAxis, YAxis, ZAxis
deplane_8 = DeconstructPlane(Plane=rh_out_grd_interface5)  # -> Origin, XAxis, YAxis, ZAxis
deplane_9 = DeconstructPlane(Plane=rh_out_grd_interface6)  # -> Origin, XAxis, YAxis, ZAxis
deplane_10 = DeconstructPlane(Plane=rh_out_grd_interface4)  # -> Origin, XAxis, YAxis, ZAxis
vdis = VectorDisplay(Anchor=deplane_6.Origin, Vector=deplane_6.XAxis)
vdis_2 = VectorDisplay(Anchor=deplane_6.Origin, Vector=deplane_6.ZAxis)
vdis_3 = VectorDisplay(Anchor=deplane_7.Origin, Vector=deplane_7.ZAxis)
vdis_4 = VectorDisplay(Anchor=deplane_3.Origin, Vector=deplane_3.ZAxis)
vdis_5 = VectorDisplay(Anchor=deplane_5.Origin, Vector=deplane_5.ZAxis)
vdis_6 = VectorDisplay(Anchor=deplane_4.Origin, Vector=deplane_4.XAxis)
vdis_7 = VectorDisplay(Anchor=deplane_4.Origin, Vector=deplane_4.ZAxis)
vdis_8 = VectorDisplay(Anchor=deplane_7.Origin, Vector=deplane_7.XAxis)
vdis_9 = VectorDisplay(Anchor=deplane_9.Origin, Vector=deplane_9.XAxis)
vdis_10 = VectorDisplay(Anchor=deplane_9.Origin, Vector=deplane_9.ZAxis)
vdis_11 = VectorDisplay(Anchor=deplane_8.Origin, Vector=deplane_8.ZAxis)
vdis_12 = VectorDisplay(Anchor=deplane_8.Origin, Vector=deplane_8.XAxis)
vdis_13 = VectorDisplay(Anchor=deplane_10.Origin, Vector=deplane_10.ZAxis)
vdis_14 = VectorDisplay(Anchor=deplane_10.Origin, Vector=deplane_10.XAxis)
