# Grasshopper definition abutment_d1.gh (Grasshopper 1.0.7)

ledge_width = Slider(1000, range=100..1000)
ledge_height = Slider(696, range=100..1000)
width = Slider(4968, range=3500..12000)
height = Slider(4042, range=0..6000)
interface_offset = Slider(1000, range=1..5000)

# ---- group: RH_IN:ABT_height
abt_height = GetNumber(height, AtLeast=1, AtMost=1, Maximum=1.797693135e+308, Minimum=-1.797693135e+308, TreeAccess=False)

# ----
multiplication = Multiplication(A=abt_height, B=0.2)

# ---- group: RH_IN:ABT_ledgeheight
abt_ledgeheight = GetNumber(ledge_height, AtLeast=1, AtMost=1, Maximum=1.797693135e+308, Minimum=-1.797693135e+308, TreeAccess=False)

# ---- group: RH_IN:ABT_ledgewidth
abt_ledgewidth = GetNumber(ledge_width, AtLeast=1, AtMost=1, Maximum=1.797693135e+308, Minimum=-1.797693135e+308, TreeAccess=False)

# ---- group: RH_IN:ABT_width
abt_width = GetNumber(width, AtLeast=1, AtMost=1, Maximum=1.797693135e+308, Minimum=-1.797693135e+308, TreeAccess=False)

# ---- group: RH_IN:ABT_offset
abt_offset = GetNumber(interface_offset, AtLeast=1, AtMost=1, Maximum=1.797693135e+308, Minimum=-1.797693135e+308, TreeAccess=False)

# ----
multiplication_2 = Multiplication(A=abt_height, B=-1.5)
subtraction = Subtraction(A=abt_height, B=abt_ledgeheight)
neg = Negative(Value=abt_ledgewidth)
subtraction_2 = Subtraction(A=abt_height, B=multiplication)
neg_2 = Negative(Value=multiplication)
vec = VectorXYZ(XComponent=0, YComponent=neg_2, ZComponent=0)  # -> Vector, Length
vec_2 = VectorXYZ(XComponent=0, YComponent=multiplication_2, ZComponent=abt_height)  # -> Vector, Length
vec_3 = VectorXYZ(XComponent=0, YComponent=neg, ZComponent=abt_height)  # -> Vector, Length
vec_4 = VectorXYZ(XComponent=0, YComponent=multiplication_2, ZComponent=subtraction_2)  # -> Vector, Length
vec_5 = VectorXYZ(XComponent=0, YComponent=0, ZComponent=subtraction)  # -> Vector, Length
vec_6 = VectorXYZ(XComponent=0, YComponent=neg, ZComponent=subtraction)  # -> Vector, Length
pt = Point("0, 0, 0")
merge = Merge(
    Data1=pt,
    Data2=vec_5.Vector,
    Data3=vec_6.Vector,
    Data4=vec_3.Vector,
    Data5=vec_2.Vector,
    Data6=vec_4.Vector,
    Data7=vec.Vector)
pline = PolyLine(Vertices=merge, Closed=True)
crv = Curve(pline)
fillet = FilletDistance(Curve=crv, Distance=40)
explode = Explode(Curve=fillet, Recursive=True)  # -> Segments, Vertices
X = UnitX(Factor=abt_width)
pline_2 = PolyLine(Vertices=explode.Vertices, Closed=False)
division = Division(A=abt_width, B=2)
extr = Extrude(Base=pline_2, Direction=X)
cap = CapHoles(Brep=extr)

# ---- group: RH_OUT:ABT_brep
brep = Brep(cap)

# ----
subtraction_3 = Subtraction(A=division, B=abt_offset)
debrep = DeconstructBrep(Brep=cap)  # -> Faces, Edges, Vertices
item = ListItem(List=debrep.Faces, Index=4, Wrap=True)
X_2 = UnitX(Factor=subtraction_3)
area = Area(Geometry=item)  # -> Area, Centroid
neg_3 = Negative(Value=X_2)
pl_origin = PlaneOrigin(Base=item, Origin=area.Centroid)
pflip = FlipPlane(Plane=pl_origin, ReverseX=False, ReverseY=False, SwapAxes=True)
prot = RotatePlane(Plane=pflip, Angle=1.570796327)
move = Move(Geometry=prot, Motion=neg_3)  # -> Geometry, Transform
move_2 = Move(Geometry=prot, Motion=X_2)  # -> Geometry, Transform

# ---- group: RH_OUT:ABT_interface1
pln = Plane(move.Geometry)

# ---- group: RH_OUT:ABT_interface3
pln_2 = Plane(move_2.Geometry)

# ---- group: RH_OUT:ABT_interface2
pln_3 = Plane(prot)

# ----
deplane = DeconstructPlane(Plane=pln)  # -> Origin, XAxis, YAxis, ZAxis
deplane_2 = DeconstructPlane(Plane=pln_2)  # -> Origin, XAxis, YAxis, ZAxis
deplane_3 = DeconstructPlane(Plane=pln_3)  # -> Origin, XAxis, YAxis, ZAxis
vdis = VectorDisplay(Anchor=deplane.Origin, Vector=deplane.ZAxis)
vdis_2 = VectorDisplay(Anchor=deplane_3.Origin, Vector=deplane_3.ZAxis)
vdis_3 = VectorDisplay(Anchor=deplane_2.Origin, Vector=deplane_2.ZAxis)
vdis_4 = VectorDisplay(Anchor=deplane.Origin, Vector=deplane.XAxis)
vdis_5 = VectorDisplay(Anchor=deplane_3.Origin, Vector=deplane_3.XAxis)
vdis_6 = VectorDisplay(Anchor=deplane_2.Origin, Vector=deplane_2.XAxis)
