# Grasshopper definition abutment_middle_d2.gh (Grasshopper 1.0.7)

abt_md_length = GetNumber(Slider(2192, range=0..3000), AtLeast=1, AtMost=1, Maximum=1.797693135e+308, Minimum=-1.797693135e+308, TreeAccess=False)
abt_md_thickness = GetNumber(Slider(372, range=0..3000), AtLeast=1, AtMost=1, Maximum=1.797693135e+308, Minimum=-1.797693135e+308, TreeAccess=False)
abt_md_height = GetNumber(Slider(1590, range=0..3000), AtLeast=1, AtMost=1, Maximum=1.797693135e+308, Minimum=-1.797693135e+308, TreeAccess=False)
box = DomainBox(Base=PlaneXY(0, 0, 0), X=abt_md_length, Y=abt_md_thickness, Z=abt_md_height)
division = Division(A=abt_md_thickness, B=2)
division_2 = Division(A=abt_md_length, B=2)

# ---- group: RH_OUT:ABT_MD_brep
brep = Brep(box)

# ----
debrep = DeconstructBrep(Brep=box)  # -> Faces, Edges, Vertices
item = ListItem(List=debrep.Faces, Index=5, Wrap=True)
item_2 = ListItem(List=debrep.Faces, Index=4, Wrap=True)
area = Area(Geometry=item)  # -> Area, Centroid
area_2 = Area(Geometry=item_2)  # -> Area, Centroid
item_3 = ListItem(List=debrep.Faces, Index=0, Wrap=True)
subtraction = Subtraction(A=division_2, B=division)
area_3 = Area(Geometry=item_3)  # -> Area, Centroid
pl_origin = PlaneOrigin(Base=item, Origin=area.Centroid)
pl_origin_2 = PlaneOrigin(Base=item_2, Origin=area_2.Centroid)
pl_origin_3 = PlaneOrigin(Base=item_3, Origin=area_3.Centroid)
pflip = FlipPlane(Plane=pl_origin, ReverseX=False, ReverseY=False, SwapAxes=True)
deplane = DeconstructPlane(Plane=pl_origin_3)  # -> Origin, XAxis, YAxis, ZAxis
multiplication = Multiplication(A=deplane.YAxis, B=subtraction)
vec = VectorXYZ(XComponent=multiplication, YComponent=0, ZComponent=0)  # -> Vector, Length
neg = Negative(Value=vec.Vector)
rotate = Rotate(Geometry=pflip, Angle=4.71238898, Plane=pflip)  # -> Geometry, Transform
move = Move(Geometry=pl_origin_3, Motion=vec.Vector)  # -> Geometry, Transform
move_2 = Move(Geometry=pl_origin_3, Motion=neg)  # -> Geometry, Transform

# ---- group: RH_OUT:ABT_SD_interface4
pln = Plane(rotate.Geometry)

# ----
pflip_2 = FlipPlane(Plane=move.Geometry, ReverseX=False, ReverseY=False, SwapAxes=True)
pflip_3 = FlipPlane(Plane=move_2.Geometry, ReverseX=False, ReverseY=False, SwapAxes=True)
pflip_4 = FlipPlane(Plane=pl_origin_2, ReverseX=False, ReverseY=False, SwapAxes=True)

# ---- group: RH_OUT:ABT_SD_interface1
pln_2 = Plane(move.Geometry)

# ---- group: RH_OUT:ABT_SD_interface3
pln_3 = Plane(pl_origin_2)

# ----
deplane_2 = DeconstructPlane(Plane=pln)  # -> Origin, XAxis, YAxis, ZAxis

# ---- group: RH_OUT:ABT_SD_interface2
pln_4 = Plane(move_2.Geometry)

# ----
deplane_3 = DeconstructPlane(Plane=pln_2)  # -> Origin, XAxis, YAxis, ZAxis
deplane_4 = DeconstructPlane(Plane=pln_3)  # -> Origin, XAxis, YAxis, ZAxis
deplane_5 = DeconstructPlane(Plane=pln_4)  # -> Origin, XAxis, YAxis, ZAxis
vdis = VectorDisplay(Anchor=deplane_2.Origin, Vector=deplane_2.XAxis)
vdis_2 = VectorDisplay(Anchor=deplane_2.Origin, Vector=deplane_2.ZAxis)
vdis_3 = VectorDisplay(Anchor=deplane_3.Origin, Vector=deplane_3.XAxis)
vdis_4 = VectorDisplay(Anchor=deplane_3.Origin, Vector=deplane_3.ZAxis)
vdis_5 = VectorDisplay(Anchor=deplane_4.Origin, Vector=deplane_4.XAxis)
vdis_6 = VectorDisplay(Anchor=deplane_4.Origin, Vector=deplane_4.ZAxis)
vdis_7 = VectorDisplay(Anchor=deplane_5.Origin, Vector=deplane_5.XAxis)
vdis_8 = VectorDisplay(Anchor=deplane_5.Origin, Vector=deplane_5.ZAxis)
