# Grasshopper definition abutment_top_d2.gh (Grasshopper 1.0.7)

abt_top_width = GetNumber(Slider(1972, range=0..3000), AtLeast=1, AtMost=1, Maximum=1.797693135e+308, Minimum=-1.797693135e+308, TreeAccess=False)
abt_top_length = GetNumber(Slider(3000, range=0..3000), AtLeast=1, AtMost=1, Maximum=1.797693135e+308, Minimum=-1.797693135e+308, TreeAccess=False)
abt_top_offset = GetNumber(Slider(260, range=0..3000), AtLeast=1, AtMost=1, Maximum=1.797693135e+308, Minimum=-1.797693135e+308, TreeAccess=False)
abt_top_thickness = GetNumber(Slider(468, range=0..3000), AtLeast=1, AtMost=1, Maximum=1.797693135e+308, Minimum=-1.797693135e+308, TreeAccess=False)
box = DomainBox(Base=PlaneXY(0, 0, 0), X=abt_top_width, Y=abt_top_length, Z=abt_top_thickness)
division = Division(A=abt_top_width, B=2)

# ---- group: RH_OUT:ABT_TOP_brep
brep = Brep(box)

# ----
subtraction = Subtraction(A=division, B=abt_top_offset)
debrep = DeconstructBrep(Brep=box)  # -> Faces, Edges, Vertices
vec = VectorXYZ(XComponent=subtraction, YComponent=0, ZComponent=0)  # -> Vector, Length
item = ListItem(List=debrep.Faces, Index=0, Wrap=True)
item_2 = ListItem(List=debrep.Faces, Index=4, Wrap=True)
item_3 = ListItem(List=debrep.Faces, Index=4, Wrap=True)
area = Area(Geometry=item)  # -> Area, Centroid
area_2 = Area(Geometry=item_2)  # -> Area, Centroid
area_3 = Area(Geometry=item_3)  # -> Area, Centroid
neg = Negative(Value=vec.Vector)
pl_origin = PlaneOrigin(Base=item_2, Origin=area_2.Centroid)
pl_origin_2 = PlaneOrigin(Base=item_3, Origin=area_3.Centroid)
pl_origin_3 = PlaneOrigin(Base=item, Origin=area.Centroid)
move = Move(Geometry=pl_origin, Motion=neg)  # -> Geometry, Transform
move_2 = Move(Geometry=pl_origin_2, Motion=vec.Vector)  # -> Geometry, Transform
move_3 = Move(Geometry=pl_origin_3, Motion=Vector(0, 0, 10))  # -> Geometry, Transform
move_4 = Move(Geometry=move.Geometry, Motion=Vector(0, 0, 10))  # -> Geometry, Transform
move_5 = Move(Geometry=move_2.Geometry, Motion=Vector(0, 0, 10))  # -> Geometry, Transform

# ---- group: RH_OUT:ABT_TOP_interface1
pln = Plane(move_3.Geometry)

# ---- group: RH_OUT:ABT_TOP_interface3
pln_2 = Plane(move_4.Geometry)

# ---- group: RH_OUT:ABT_TOP_interface2
pln_3 = Plane(move_5.Geometry)

# ----
deplane = DeconstructPlane(Plane=pln)  # -> Origin, XAxis, YAxis, ZAxis
deplane_2 = DeconstructPlane(Plane=pln_2)  # -> Origin, XAxis, YAxis, ZAxis
deplane_3 = DeconstructPlane(Plane=pln_3)  # -> Origin, XAxis, YAxis, ZAxis
vdis = VectorDisplay(Anchor=deplane.Origin, Vector=deplane.XAxis)
vdis_2 = VectorDisplay(Anchor=deplane.Origin, Vector=deplane.ZAxis)
vdis_3 = VectorDisplay(Anchor=deplane_2.Origin, Vector=deplane_2.XAxis)
vdis_4 = VectorDisplay(Anchor=deplane_3.Origin, Vector=deplane_3.XAxis)
vdis_5 = VectorDisplay(Anchor=deplane_2.Origin, Vector=deplane_2.ZAxis)
vdis_6 = VectorDisplay(Anchor=deplane_3.Origin, Vector=deplane_3.ZAxis)
