# Grasshopper definition bearing.gh (Grasshopper 1.0.8)

height = Slider(28, range=10..100)
width = Slider(299, range=100..1000)

# ---- group: RH_IN:BR_width
br_width = GetNumber(width, AtLeast=1, AtMost=1, Maximum=1.797693135e+308, Minimum=-1.797693135e+308, TreeAccess=False)

# ---- group: RH_IN:BR_height
br_height = GetNumber(height, AtLeast=1, AtMost=1, Maximum=1.797693135e+308, Minimum=-1.797693135e+308, TreeAccess=False)

# ----
box = DomainBox(Base=PlaneXY(0, 0, 0), X=br_width, Y=br_width, Z=br_height)

# ---- group: RH_OUT:BR_brep
brep = Brep(box)

# ----
debrep = DeconstructBrep(Brep=box)  # -> Faces, Edges, Vertices
item = ListItem(List=debrep.Faces, Index=4, Wrap=True)
item_2 = ListItem(List=debrep.Faces, Index=5, Wrap=True)
area = Area(Geometry=item)  # -> Area, Centroid
xy = XYPlane(Origin=Point(0, 0, 0))
area_2 = Area(Geometry=item_2)  # -> Area, Centroid
pl_origin = PlaneOrigin(Base=xy, Origin=area.Centroid)
pl_origin_2 = PlaneOrigin(Base=xy, Origin=area_2.Centroid)
pflip = FlipPlane(Plane=pl_origin_2, ReverseX=False, ReverseY=False, SwapAxes=True)
rh_out_br_interface2 = Plane(pflip)

# ---- group: RH_OUT:BR_interface1
pln = Plane(pl_origin)

# ----
deplane = DeconstructPlane(Plane=pln)  # -> Origin, XAxis, YAxis, ZAxis
deplane_2 = DeconstructPlane(Plane=rh_out_br_interface2)  # -> Origin, XAxis, YAxis, ZAxis
vdis = VectorDisplay(Anchor=deplane.Origin, Vector=deplane.ZAxis)
vdis_2 = VectorDisplay(Anchor=deplane_2.Origin, Vector=deplane_2.ZAxis)
