# Grasshopper definition expansion_d3.gh (Grasshopper 1.0.7)

exp_length = GetNumber(Slider(2212, range=1..10000), AtLeast=1, AtMost=1, Maximum=1.797693135e+308, Minimum=-1.797693135e+308, TreeAccess=False)
vec = VectorXYZ(XComponent=0, YComponent=90, ZComponent=0)  # -> Vector, Length
vec_2 = VectorXYZ(XComponent=150, YComponent=0, ZComponent=0)  # -> Vector, Length
rec_2pt = Rectangle2Pt(Plane=PlaneXY(0, 0, 0), PointA=vec_2.Vector, PointB=vec.Vector, Radius=0)  # -> Rectangle, Length
explode = Explode(Curve=rec_2pt.Rectangle, Recursive=True)  # -> Segments, Vertices
ln = Line(StartPoint=Point(0, 0, 0), EndPoint=vec_2.Vector)
cull_i = CullIndex(List=explode.Vertices, Indices=0, Wrap=True)
divide = DivideCurve(Curve=ln, Count=6, Kinks=False)  # -> Points, Tangents, Parameters
series = Series(Start=0, Step=5, Count=7)
mod = Modulus(A=series, B=2)
remap = RemapNumbers(Value=mod, Source=Domain(0, 1), Target=Domain(0, 1))  # -> Mapped, Clipped
pline = PolyLine(Vertices=cull_i, Closed=False)
multiplication = Multiplication(A=mod, B=25)
Y = UnitY(Factor=multiplication)
move = Move(Geometry=divide.Points, Motion=Y)  # -> Geometry, Transform
pline_2 = PolyLine(Vertices=move.Geometry, Closed=False)
merge = Merge(Data1=pline, Data2=pline_2)
connect = ConnectCurves(Curves=merge, Continuity=0, Close=False, Bulge=1)
Z = UnitZ(Factor=exp_length)
flatten = FlattenTree(Tree=connect, Path="{0}")
extr = Extrude(Base=flatten, Direction=Z)
sunion = SolidUnion(Breps=extr)
cap = CapHoles(Brep=sunion)

# ---- group: RH_OUT:EXP_brep
brep = Brep(cap)

# ----
debrep = DeconstructBrep(Brep=cap)  # -> Faces, Edges, Vertices
item = ListItem(List=debrep.Faces, Index=0, Wrap=True)
item_2 = ListItem(List=debrep.Faces, Index=1, Wrap=True)
area = Area(Geometry=item_2)  # -> Area, Centroid
area_2 = Area(Geometry=item)  # -> Area, Centroid
pl_origin = PlaneOrigin(Base=item_2, Origin=area.Centroid)
pl_origin_2 = PlaneOrigin(Base=item, Origin=area_2.Centroid)
prot = RotatePlane(Plane=pl_origin, Angle=1.570796327)
pflip = FlipPlane(Plane=pl_origin_2, ReverseX=False, ReverseY=False, SwapAxes=True)

# ---- group: RH_OUT:EXP_interface1
pln = Plane(prot)

# ----
prot_2 = RotatePlane(Plane=pflip, Angle=3.141592654)

# ---- group: RH_OUT:EXP_interface2
pln_2 = Plane(prot_2)

# ----
deplane = DeconstructPlane(Plane=pln)  # -> Origin, XAxis, YAxis, ZAxis
deplane_2 = DeconstructPlane(Plane=pln_2)  # -> Origin, XAxis, YAxis, ZAxis
vdis = VectorDisplay(Anchor=deplane_2.Origin, Vector=deplane_2.XAxis)
vdis_2 = VectorDisplay(Anchor=deplane.Origin, Vector=deplane.XAxis)
vdis_3 = VectorDisplay(Anchor=deplane.Origin, Vector=deplane.ZAxis)
vdis_4 = VectorDisplay(Anchor=deplane_2.Origin, Vector=deplane_2.ZAxis)
