# Grasshopper definition fahrbahn_d3.gh (Grasshopper 1.0.7)

num = Number(250)
num_2 = Number(100)
fb_length = GetNumber(Slider(2763, range=0..10000), AtLeast=1, AtMost=1, Maximum=1.797693135e+308, Minimum=-1.797693135e+308, TreeAccess=False)
fb_width = GetNumber(Slider(5131, range=0..10000), AtLeast=1, AtMost=1, Maximum=1.797693135e+308, Minimum=-1.797693135e+308, TreeAccess=False)
get_number = GetNumber(num_2, AtLeast=1, AtMost=1, Maximum=1.797693135e+308, Minimum=-1.797693135e+308, TreeAccess=False)
get_number_2 = GetNumber(num, AtLeast=1, AtMost=1, Maximum=1.797693135e+308, Minimum=-1.797693135e+308, TreeAccess=False)
vec = VectorXYZ(XComponent=get_number, YComponent=0, ZComponent=0)  # -> Vector, Length
vec_2 = VectorXYZ(XComponent=0, YComponent=0, ZComponent=0)  # -> Vector, Length
division = Division(A=fb_width, B=2)
vec_3 = VectorXYZ(XComponent=get_number_2, YComponent=division, ZComponent=0)  # -> Vector, Length
vec_4 = VectorXYZ(XComponent=get_number, YComponent=fb_width, ZComponent=0)  # -> Vector, Length
vec_5 = VectorXYZ(XComponent=0, YComponent=fb_width, ZComponent=0)  # -> Vector, Length
ln = Line(StartPoint=vec_2.Vector, EndPoint=vec.Vector)
ln_2 = Line(StartPoint=vec.Vector, EndPoint=vec_3.Vector)
ln_3 = Line(StartPoint=vec_3.Vector, EndPoint=vec_4.Vector)
ln_4 = Line(StartPoint=vec_5.Vector, EndPoint=vec_2.Vector)
ln_5 = Line(StartPoint=vec_4.Vector, EndPoint=vec_5.Vector)
merge = Merge(Data1=ln, Data2=ln_2, Data3=ln_3, Data4=ln_5, Data5=ln_4)
join = JoinCurves(Curves=merge, Preserve=False)
Z = UnitZ(Factor=fb_length)
extr = Extrude(Base=join, Direction=Z)
cap = CapHoles(Brep=extr)

# ---- group: RH_OUT:FB_brep
brep = Brep(cap)

# ----
debrep = DeconstructBrep(Brep=cap)  # -> Faces, Edges, Vertices
division_2 = Division(A=fb_length, B=2)
item = ListItem(List=debrep.Faces, Index=1, Wrap=True)
area = Area(Geometry=item)  # -> Area, Centroid
Z_2 = UnitZ(Factor=division_2)
pl_origin = PlaneOrigin(Base=item, Origin=area.Centroid)
neg = Negative(Value=Z_2)
move = Move(Geometry=pl_origin, Motion=neg)  # -> Geometry, Transform
prot = RotatePlane(Plane=move.Geometry, Angle=4.71238898)

# ---- group: RH_OUT:FB_interface1
pln = Plane(prot)

# ----
deplane = DeconstructPlane(Plane=pln)  # -> Origin, XAxis, YAxis, ZAxis
vdis = VectorDisplay(Anchor=deplane.Origin, Vector=deplane.XAxis)
vdis_2 = VectorDisplay(Anchor=deplane.Origin, Vector=deplane.ZAxis)
