# Grasshopper definition foundation_d2.gh (Grasshopper 1.0.7)

fnd_girth = GetNumber(Slider(317, range=0..5000), AtLeast=1, AtMost=1, Maximum=1.797693135e+308, Minimum=-1.797693135e+308, TreeAccess=False)
fnd_length = GetNumber(Slider(1270, range=0..5000), AtLeast=1, AtMost=1, Maximum=1.797693135e+308, Minimum=-1.797693135e+308, TreeAccess=False)
fnd_thickness = GetNumber(Slider(553, range=0..5000), AtLeast=1, AtMost=1, Maximum=1.797693135e+308, Minimum=-1.797693135e+308, TreeAccess=False)
fnd_width = GetNumber(Slider(2256, range=0..5000), AtLeast=1, AtMost=1, Maximum=1.797693135e+308, Minimum=-1.797693135e+308, TreeAccess=False)
multiplication = Multiplication(A=fnd_girth, B=2)
subtraction = Subtraction(A=fnd_width, B=multiplication)
division = Division(A=fnd_girth, B=2)
division_2 = Division(A=fnd_girth, B=2)
rectangle = Rectangle(Plane=PlaneXY(0, 0, 0), XSize=fnd_width, YSize=fnd_length, Radius=0)  # -> Rectangle, Length
rectangle_2 = Rectangle(Plane=PlaneXY(0, 0, 0), XSize=subtraction, YSize=fnd_length, Radius=0)  # -> Rectangle, Length
Y = UnitY(Factor=fnd_girth)
move = Move(Geometry=rectangle_2.Rectangle, Motion=Y)  # -> Geometry, Transform
X = UnitX(Factor=fnd_girth)
move_2 = Move(Geometry=move.Geometry, Motion=X)  # -> Geometry, Transform
Z = UnitZ(Factor=fnd_thickness)
rdiff = RegionDifference(CurvesA=rectangle.Rectangle, CurvesB=move_2.Geometry)
extr = Extrude(Base=rdiff, Direction=Z)
division_3 = Division(A=fnd_width, B=2)
cap = CapHoles(Brep=extr)

# ---- group: RH_OUT:FND_brep
brep = Brep(cap)

# ----
debrep = DeconstructBrep(Brep=cap)  # -> Faces, Edges, Vertices
item = ListItem(List=debrep.Faces, Index=8, Wrap=True)
vec = VectorXYZ(XComponent=division_3, YComponent=division_2, ZComponent=Z)  # -> Vector, Length
pl_origin = PlaneOrigin(Base=item, Origin=vec.Vector)
prot = RotatePlane(Plane=pl_origin, Angle=1.570796327)

# ---- group: RH_OUT:FND_interface1
pln = Plane(prot)

# ----
deplane = DeconstructPlane(Plane=pln)  # -> Origin, XAxis, YAxis, ZAxis
vdis = VectorDisplay(Anchor=deplane.Origin, Vector=deplane.XAxis)
vdis_2 = VectorDisplay(Anchor=deplane.Origin, Vector=deplane.ZAxis)
