# Grasshopper definition girder_D1.gh (Grasshopper 1.0.8)

thickness = Slider(173, range=0..1000)
length = Slider(9318, range=0..50000)
width = Slider(3233, range=0..15000)
xy = XYPlane(Origin=Point(0, 0, 0))
box = DomainBox(Base=xy, X=length, Y=width, Z=thickness)
debrep = DeconstructBrep(Brep=box)  # -> Faces, Edges, Vertices
mesh = Mesh(box)
item = ListItem(List=debrep.Faces, Index=Slider(0, range=0..20), Wrap=True)
srf = Surface(item)
