# Grasshopper definition kappe_d3.gh (Grasshopper 1.0.7)

python = GhPythonScript(X=400, Y=300, Z=800, W=500, T=100)  # -> Crv, Pts
# ---------- python: Python ----------
"""GH Python (Rhino 7) — stepped + slanted profile polyline (like your sketch)

Inputs (set these as GH Python component inputs):
  X (float) : left vertical height (up to the step)
  Y (float) : step length (horizontal to the right)
  Z (float) : upper vertical height (from step to top)
  W (float) : total bottom width (to the far bottom-right)
  T (float) : top width (small horizontal at the top)
  P (Plane) : optional base plane (default WorldXY)
  Closed (bool) : optional, default True

Outputs:
  Crv : PolylineCurve
  Pts : points used
"""

import Rhino.Geometry as rg

# Defaults (so it runs even if some inputs aren't wired yet)
if P is None: P = rg.Plane.WorldXY
if Closed is None: Closed = True

# Basic sanity (avoid weird self-intersections)
# Require: 0 <= Y <= W and 0 <= T and (Y+T) <= W
Y = max(0.0, float(Y))
T = max(0.0, float(T))
W = float(W)
X = float(X)
Z = float(Z)

if Y > W: Y = W
if Y + T > W: T = max(0.0, W - Y)

# Helper: point in plane coords (u along plane.XAxis, v along plane.YAxis)
def pt(u, v):
    return P.PointAt(u, v)

h_step = X
h_top  = X + Z

# Profile points (counter-clockwise)
p0 = pt(0.0,    0.0)      # bottom-left
p1 = pt(0.0,    h_step)   # up X
p2 = pt(Y,      h_step)   # right Y
p3 = pt(Y,      h_top)    # up Z
p4 = pt(Y + T,  h_top)    # small top width
p5 = pt(W,      0.0)      # slanted down to bottom-right

pts = [p0, p1, p2, p3, p4, p5]
if Closed:
    pts.append(p0)

pl = rg.Polyline(pts)
Crv = rg.PolylineCurve(pl)
Pts = pts
# ---------- end python ----------
pline = PolyLine(Vertices=python.Pts, Closed=False)
kp_length = GetNumber(Slider(1000, range=1..1000), AtLeast=1, AtMost=1, Maximum=1.797693135e+308, Minimum=-1.797693135e+308, TreeAccess=False)
fillet = FilletDistance(Curve=pline, Distance=10)
explode = Explode(Curve=fillet, Recursive=True)  # -> Segments, Vertices
Z = UnitZ(Factor=kp_length)
pline_2 = PolyLine(Vertices=explode.Vertices, Closed=False)
extr = Extrude(Base=pline_2, Direction=Z)
cap = CapHoles(Brep=extr)

# ---- group: RH_OUT:KP_brep
brep = Brep(cap)

# ----
debrep = DeconstructBrep(Brep=cap)  # -> Faces, Edges, Vertices
item = ListItem(List=debrep.Faces, Index=13, Wrap=True)
item_2 = ListItem(List=debrep.Faces, Index=12, Wrap=True)
item_3 = ListItem(List=debrep.Faces, Index=6, Wrap=True)
xy = XYPlane(Origin=Point(0, 0, 0))
area = Area(Geometry=item)  # -> Area, Centroid
xy_2 = XYPlane(Origin=Point(0, 0, 0))
area_2 = Area(Geometry=item_2)  # -> Area, Centroid
area_3 = Area(Geometry=item_3)  # -> Area, Centroid
pl_origin = PlaneOrigin(Base=xy, Origin=area.Centroid)
pl_origin_2 = PlaneOrigin(Base=xy_2, Origin=area_2.Centroid)
pl_origin_3 = PlaneOrigin(Base=item_3, Origin=area_3.Centroid)

# ---- group: RH_OUT:KP_interface2
pln = Plane(pl_origin_2)

# ---- group: RH_OUT:KP_interface3
pln_2 = Plane(pl_origin)

# ---- group: RH_OUT:KP_interface1
pln_3 = Plane(pl_origin_3)

# ----
deplane = DeconstructPlane(Plane=pln)  # -> Origin, XAxis, YAxis, ZAxis
deplane_2 = DeconstructPlane(Plane=pln_2)  # -> Origin, XAxis, YAxis, ZAxis
deplane_3 = DeconstructPlane(Plane=pln_3)  # -> Origin, XAxis, YAxis, ZAxis
vdis = VectorDisplay(Anchor=deplane_2.Origin, Vector=deplane_2.XAxis)
vdis_2 = VectorDisplay(Anchor=deplane_2.Origin, Vector=deplane_2.ZAxis)
vdis_3 = VectorDisplay(Anchor=deplane.Origin, Vector=deplane.XAxis)
vdis_4 = VectorDisplay(Anchor=deplane.Origin, Vector=deplane.ZAxis)
vdis_5 = VectorDisplay(Anchor=deplane_3.Origin, Vector=deplane_3.XAxis)
vdis_6 = VectorDisplay(Anchor=deplane_3.Origin, Vector=deplane_3.ZAxis)
