# Grasshopper definition springingpoint.gh (Grasshopper 1.0.8)

width = Slider(2689.95, range=0..10000)
length = Slider(1086.424, range=0..10000)
angle = Slider(23.961, range=0..90)
ss_width = GetNumber(width, AtLeast=1, AtMost=1, Maximum=1.797693135e+308, Minimum=-1.797693135e+308, TreeAccess=False)
ss_angle = GetNumber(angle, AtLeast=1, AtMost=1, Maximum=1.797693135e+308, Minimum=-1.797693135e+308, Prompt="f", TreeAccess=False)
ss_length = GetNumber(length, AtLeast=1, AtMost=1, Maximum=1.797693135e+308, Minimum=-1.797693135e+308, TreeAccess=False)
rad = Radians(Degrees=ss_angle)
sin = Sine(Value=rad)
cos = Cosine(Value=rad)
rad_2 = Radians(Degrees=270)
vec = VectorXYZ(XComponent=0, YComponent=0, ZComponent=0)  # -> Vector, Length
vec_2 = VectorXYZ(XComponent=cos, YComponent=sin, ZComponent=0)  # -> Vector, Length
vec_3 = VectorXYZ(XComponent=0, YComponent=-1, ZComponent=0)  # -> Vector, Length
rotate = Rotate(Geometry=vec_2.Vector, Angle=rad_2, Plane=PlaneXY(0, 0, 0))  # -> Geometry, Transform
X = UnitX(Factor=1)
line = LineSDL(Start=vec.Vector, Direction=vec_2.Vector, Length=ss_length)
end = EndPoints(Curve=line)  # -> Start, End
line_2 = LineSDL(Start=end.End, Direction=rotate.Geometry, Length=200)
end_2 = EndPoints(Curve=line_2)  # -> Start, End
pdecon = Deconstruct(Point=end_2.End)  # -> XComponent, YComponent, ZComponent
line_3 = LineSDL(Start=end.Start, Direction=vec_3.Vector, Length=500)
end_3 = EndPoints(Curve=line_3)  # -> Start, End
pdecon_2 = Deconstruct(Point=end_3.End)  # -> XComponent, YComponent, ZComponent
subtraction = Subtraction(A=pdecon.XComponent, B=pdecon_2.XComponent)
line_4 = LineSDL(Start=end_3.End, Direction=X, Length=subtraction)
end_4 = EndPoints(Curve=line_4)  # -> Start, End
ln = Line(StartPoint=end_4.End, EndPoint=end_2.End)
boundary = BoundarySurfaces(Edges=[line, line_2, line_3, line_4, ln])
Z = UnitZ(Factor=ss_width)
extr = Extrude(Base=boundary, Direction=Z)

# ---- group: RH_OUT:SS_brep
brep = Brep(extr)

# ----
debrep = DeconstructBrep(Brep=extr)  # -> Faces, Edges, Vertices
item = ListItem(List=debrep.Faces, Index=3, Wrap=True)
area = Area(Geometry=item)  # -> Area, Centroid
pl_origin = PlaneOrigin(Base=item, Origin=area.Centroid)

# ---- group: RH_OUT:SS_interface1
pln = Plane(pl_origin)

# ----
deplane = DeconstructPlane(Plane=pln)  # -> Origin, XAxis, YAxis, ZAxis
vdis = VectorDisplay(Anchor=deplane.Origin, Vector=[deplane.XAxis, deplane.YAxis, deplane.ZAxis])
