# Grasshopper definition t_girder_d2.gh (Grasshopper 1.0.7)

interface_offset = Slider(1000, range=1..1000)
number_slider = Slider(11963, range=10000..25000)
t_height = Slider(842, range=300..1000)
thickness = Slider(370, range=300..1000)
t_offset = Slider(899, range=10..3000)
t_thickness = Slider(554, range=300..1000)
nr_t = Slider(3, range=2..3)
wdth = Slider(5873, range=1000..12000)

# ---- group: RH_IN:D2_GRD_nr_t
d2_grd_nr_t = GetNumber(nr_t, AtLeast=1, AtMost=1, Maximum=1.797693135e+308, Minimum=-1.797693135e+308, TreeAccess=False)

# ---- group: RH_IN:D2_GRD_t_offset
d2_grd_t_offset = GetNumber(t_offset, AtLeast=1, AtMost=1, Maximum=1.797693135e+308, Minimum=-1.797693135e+308, TreeAccess=False)

# ---- group: RH_IN:D2_GRD_iface_offset
d2_grd_iface_offset = GetNumber(interface_offset, AtLeast=1, AtMost=1, Maximum=1.797693135e+308, Minimum=-1.797693135e+308, TreeAccess=False)

# ---- group: RH_IN:D2_GRD_t_thickness
d2_grd_t_thickness = GetNumber(t_thickness, AtLeast=1, AtMost=1, Maximum=1.797693135e+308, Minimum=-1.797693135e+308, TreeAccess=False)

# ---- group: RH_IN:D2_GRD_t_height
d2_grd_t_height = GetNumber(t_height, AtLeast=1, AtMost=1, Maximum=1.797693135e+308, Minimum=-1.797693135e+308, TreeAccess=False)

# ---- group: RH_IN:D2_GRD_thickness
d2_grd_thickness = GetNumber(thickness, AtLeast=1, AtMost=1, Maximum=1.797693135e+308, Minimum=-1.797693135e+308, TreeAccess=False)

# ---- group: RH_IN:D2_GRD_width
d2_grd_width = GetNumber(wdth, AtLeast=1, AtMost=1, Maximum=1.797693135e+308, Minimum=-1.797693135e+308, TreeAccess=False)

# ---- group: RH_IN:D2_GRD_length
d2_grd_length = GetNumber(number_slider, AtLeast=1, AtMost=1, Maximum=1.797693135e+308, Minimum=-1.797693135e+308, TreeAccess=False)

# ----
xz = XZPlane(Origin=Point(0, 0, 0))
subtraction = Subtraction(A=d2_grd_width, B=d2_grd_t_offset)
equals = Equality(FirstNumber=d2_grd_nr_t, SecondNumber=3)  # -> Equality, Inequality
subtraction_2 = Subtraction(A=d2_grd_width, B=d2_grd_t_thickness)
neg = Negative(Value=d2_grd_t_height)
subtraction_3 = Subtraction(A=subtraction, B=d2_grd_t_thickness)
rectangle = Rectangle(Plane=xz, XSize=d2_grd_t_thickness, YSize=neg, Radius=0)  # -> Rectangle, Length
division = Division(A=subtraction_2, B=2)
rectangle_2 = Rectangle(Plane=xz, XSize=d2_grd_width, YSize=d2_grd_thickness, Radius=0)  # -> Rectangle, Length
X = UnitX(Factor=d2_grd_t_offset)
X_2 = UnitX(Factor=d2_grd_t_offset)
X_3 = UnitX(Factor=subtraction_3)
X_4 = UnitX(Factor=division)
move = Move(Geometry=rectangle.Rectangle, Motion=X)  # -> Geometry, Transform
move_2 = Move(Geometry=rectangle.Rectangle, Motion=X_3)  # -> Geometry, Transform
move_3 = Move(Geometry=rectangle.Rectangle, Motion=X_4)  # -> Geometry, Transform
filter = StreamFilter(Gate=equals.Equality, Stream1=move_3.Geometry)
merge = Merge(Data1=rectangle_2.Rectangle, Data2=move.Geometry, Data3=move_2.Geometry, Data4=filter)
Y = UnitY(Factor=d2_grd_length)
runion = RegionUnion(Curves=merge)
fillet = FilletDistance(Curve=runion, Distance=40)
explode = Explode(Curve=fillet, Recursive=True)  # -> Segments, Vertices
pline = PolyLine(Vertices=explode.Vertices, Closed=False)
extr = Extrude(Base=pline, Direction=Y)
cap = CapHoles(Brep=extr)

# ---- group: RH_OUT:D2_GRD_brep
brep = Brep(cap)

# ----
debrep = DeconstructBrep(Brep=cap)  # -> Faces, Edges, Vertices
division_2 = Division(A=number_slider, B=2)
item = ListItem(List=debrep.Faces, Index=6, Wrap=True)
item_2 = ListItem(List=debrep.Faces, Index=14, Wrap=True)
item_3 = ListItem(List=debrep.Faces, Index=22, Wrap=True)
area = Area(Geometry=item)  # -> Area, Centroid
subtraction_4 = Subtraction(A=division_2, B=d2_grd_iface_offset)
area_2 = Area(Geometry=item_3)  # -> Area, Centroid
area_3 = Area(Geometry=item_2)  # -> Area, Centroid
pl_origin = PlaneOrigin(Base=item, Origin=area.Centroid)
pl_origin_2 = PlaneOrigin(Base=item_3, Origin=area_2.Centroid)
pl_origin_3 = PlaneOrigin(Base=item_2, Origin=area_3.Centroid)
Y_2 = UnitY(Factor=subtraction_4)
neg_2 = Negative(Value=Y_2)
move_4 = Move(Geometry=pl_origin, Motion=Y_2)  # -> Geometry, Transform
move_5 = Move(Geometry=pl_origin_3, Motion=Y_2)  # -> Geometry, Transform
move_6 = Move(Geometry=pl_origin_2, Motion=Y_2)  # -> Geometry, Transform
move_7 = Move(Geometry=pl_origin, Motion=neg_2)  # -> Geometry, Transform
move_8 = Move(Geometry=pl_origin_3, Motion=neg_2)  # -> Geometry, Transform
move_9 = Move(Geometry=pl_origin_2, Motion=neg_2)  # -> Geometry, Transform

# ---- group: RH_OUT:D2_GRD_interface3
pln = Plane(move_6.Geometry)

# ---- group: RH_OUT:D2_GRD_interface2
pln_2 = Plane(move_5.Geometry)

# ---- group: RH_OUT:D2_GRD_interface1
pln_3 = Plane(move_4.Geometry)

# ---- group: RH_OUT:D2_GRD_interface6
pln_4 = Plane(move_9.Geometry)

# ---- group: RH_OUT:D2_GRD_interface4
pln_5 = Plane(move_7.Geometry)

# ---- group: RH_OUT:D2_GRD_interface5
pln_6 = Plane(move_8.Geometry)

# ----
deplane = DeconstructPlane(Plane=pln_3)  # -> Origin, XAxis, YAxis, ZAxis
deplane_2 = DeconstructPlane(Plane=pln_2)  # -> Origin, XAxis, YAxis, ZAxis
deplane_3 = DeconstructPlane(Plane=pln_5)  # -> Origin, XAxis, YAxis, ZAxis
deplane_4 = DeconstructPlane(Plane=pln)  # -> Origin, XAxis, YAxis, ZAxis
deplane_5 = DeconstructPlane(Plane=pln_6)  # -> Origin, XAxis, YAxis, ZAxis
deplane_6 = DeconstructPlane(Plane=pln_4)  # -> Origin, XAxis, YAxis, ZAxis
vdis = VectorDisplay(Anchor=deplane.Origin, Vector=deplane.ZAxis)
vdis_2 = VectorDisplay(Anchor=deplane_3.Origin, Vector=deplane_3.ZAxis)
vdis_3 = VectorDisplay(Anchor=deplane_4.Origin, Vector=deplane_4.ZAxis)
vdis_4 = VectorDisplay(Anchor=deplane_2.Origin, Vector=deplane_2.ZAxis)
vdis_5 = VectorDisplay(Anchor=deplane_6.Origin, Vector=deplane_6.ZAxis)
vdis_6 = VectorDisplay(Anchor=deplane_5.Origin, Vector=deplane_5.ZAxis)
