# Grasshopper definition t_girder_module_d3.gh (Grasshopper 1.0.7)

interface_offset = Slider(1000, range=1..1000)
interface_offset_2 = Slider(1000, range=1..1000)
nr_t = Slider(3, range=2..3)
t_height = Slider(842, range=300..1000)
thickness = Slider(400, range=300..1000)
t_thickness = Slider(554, range=300..1000)
t_offset = Slider(899, range=10..3000)
wdth = Slider(6223, range=1000..12000)
d3_grd_nr_t = GetNumber(nr_t, AtLeast=1, AtMost=1, Maximum=1.797693135e+308, Minimum=-1.797693135e+308, TreeAccess=False)
d3_grd_iface_offset = GetNumber(interface_offset, AtLeast=1, AtMost=1, Maximum=1.797693135e+308, Minimum=-1.797693135e+308, TreeAccess=False)
d3_grd_t_thickness = GetNumber(t_thickness, AtLeast=1, AtMost=1, Maximum=1.797693135e+308, Minimum=-1.797693135e+308, TreeAccess=False)
d3_grd_t_offset = GetNumber(t_offset, AtLeast=1, AtMost=1, Maximum=1.797693135e+308, Minimum=-1.797693135e+308, TreeAccess=False)
d3_grd_t_height = GetNumber(t_height, AtLeast=1, AtMost=1, Maximum=1.797693135e+308, Minimum=-1.797693135e+308, TreeAccess=False)
d3_grd_thickness = GetNumber(thickness, AtLeast=1, AtMost=1, Maximum=1.797693135e+308, Minimum=-1.797693135e+308, TreeAccess=False)
d3_grd_length = GetNumber(
    Slider(11963, range=10000..25000),
    AtLeast=1,
    AtMost=1,
    Maximum=1.797693135e+308,
    Minimum=-1.797693135e+308,
    TreeAccess=False)
d3_grd_width = GetNumber(wdth, AtLeast=1, AtMost=1, Maximum=1.797693135e+308, Minimum=-1.797693135e+308, TreeAccess=False)
d3_grd_kp_size = GetNumber(interface_offset_2, AtLeast=1, AtMost=1, Maximum=1.797693135e+308, Minimum=-1.797693135e+308, TreeAccess=False)
xz = XZPlane(Origin=Point(0, 0, 0))
subtraction = Subtraction(A=d3_grd_width, B=d3_grd_t_offset)
neg = Negative(Value=d3_grd_t_height)
equals = Equality(FirstNumber=d3_grd_nr_t, SecondNumber=3)  # -> Equality, Inequality
subtraction_2 = Subtraction(A=d3_grd_width, B=d3_grd_t_thickness)
subtraction_3 = Subtraction(A=subtraction, B=d3_grd_t_thickness)
rectangle = Rectangle(Plane=xz, XSize=d3_grd_width, YSize=d3_grd_thickness, Radius=0)  # -> Rectangle, Length
rectangle_2 = Rectangle(Plane=xz, XSize=d3_grd_t_thickness, YSize=neg, Radius=0)  # -> Rectangle, Length
division = Division(A=subtraction_2, B=2)
X = UnitX(Factor=d3_grd_t_offset)
X_2 = UnitX(Factor=d3_grd_t_offset)
X_3 = UnitX(Factor=subtraction_3)
X_4 = UnitX(Factor=division)
division_2 = Division(A=d3_grd_width, B=2)
division_3 = Division(A=d3_grd_kp_size, B=2)
move = Move(Geometry=rectangle_2.Rectangle, Motion=X)  # -> Geometry, Transform
move_2 = Move(Geometry=rectangle_2.Rectangle, Motion=X_3)  # -> Geometry, Transform
move_3 = Move(Geometry=rectangle_2.Rectangle, Motion=X_4)  # -> Geometry, Transform
filter = StreamFilter(Gate=equals.Equality, Stream1=move_3.Geometry)
merge = Merge(Data1=rectangle.Rectangle, Data2=move.Geometry, Data3=move_2.Geometry, Data4=filter)
Y = UnitY(Factor=d3_grd_length)
runion = RegionUnion(Curves=merge)
fillet = FilletDistance(Curve=runion, Distance=40)
subtraction_4 = Subtraction(A=division_2, B=division_3)
explode = Explode(Curve=fillet, Recursive=True)  # -> Segments, Vertices
subtraction_5 = Subtraction(A=d3_grd_thickness, B=0)
pline = PolyLine(Vertices=explode.Vertices, Closed=False)
Z = UnitZ(Factor=subtraction_5)
extr = Extrude(Base=pline, Direction=Y)
rad = Radians(Degrees=Slider(0, range=0..360))
vec = VectorXYZ(XComponent=0, YComponent=0, ZComponent=Z)  # -> Vector, Length
vec_2 = VectorXYZ(XComponent=Slider(0, range=0..1000), YComponent=Slider(0, range=0..1000), ZComponent=0)  # -> Vector, Length
cap = CapHoles(Brep=extr)
rotate = Rotate(Geometry=cap, Angle=rad, Plane=PlaneXY(0, 0, 0))  # -> Geometry, Transform
move_4 = Move(Geometry=rotate.Geometry, Motion=vec_2.Vector)  # -> Geometry, Transform
debrep = DeconstructBrep(Brep=cap)  # -> Faces, Edges, Vertices

# ---- group: RH_OUT:D3_GRD_brep
brep = Brep(cap)

# ----
division_4 = Division(A=d3_grd_length, B=2)
item = ListItem(List=debrep.Faces, Index=14, Wrap=True)
item_2 = ListItem(List=debrep.Faces, Index=-4, Wrap=True)
item_3 = ListItem(List=debrep.Faces, Index=-4, Wrap=True)
item_4 = ListItem(List=debrep.Faces, Index=-4, Wrap=True)
item_5 = ListItem(List=debrep.Faces, Index=32, Wrap=True)
item_6 = ListItem(List=debrep.Faces, Index=33, Wrap=True)
deplane = DeconstructPlane(Plane=item)  # -> Origin, XAxis, YAxis, ZAxis
subtraction_6 = Subtraction(A=division_4, B=d3_grd_iface_offset)
area = Area(Geometry=item)  # -> Area, Centroid
area_2 = Area(Geometry=item_2)  # -> Area, Centroid
area_3 = Area(Geometry=item_3)  # -> Area, Centroid
area_4 = Area(Geometry=item_4)  # -> Area, Centroid
area_5 = Area(Geometry=item_5)  # -> Area, Centroid
area_6 = Area(Geometry=item_6)  # -> Area, Centroid
xz_2 = XZPlane(Origin=Point(0, 0, 0))
xz_3 = XZPlane(Origin=Point(0, 0, 0))
Y_2 = UnitY(Factor=subtraction_6)
multiplication = Multiplication(A=deplane.YAxis, B=subtraction_6)
devec = DeconstructVector(Vector=area_5.Centroid)  # -> XComponent, YComponent, ZComponent
neg_2 = Negative(Value=multiplication)
pl_origin = PlaneOrigin(Base=item, Origin=area.Centroid)
devec_2 = DeconstructVector(Vector=area_6.Centroid)  # -> XComponent, YComponent, ZComponent
pl_origin_2 = PlaneOrigin(Base=item_2, Origin=area_2.Centroid)
pl_origin_3 = PlaneOrigin(Base=item_3, Origin=area_3.Centroid)
pl_origin_4 = PlaneOrigin(Base=item_4, Origin=area_4.Centroid)
division_5 = Division(A=d3_grd_length, B=2)
X_5 = UnitX(Factor=subtraction_4)
X_6 = UnitX(Factor=subtraction_4)
vec_3 = VectorXYZ(XComponent=devec.XComponent, YComponent=devec.YComponent, ZComponent=0)  # -> Vector, Length
vec_4 = VectorXYZ(XComponent=devec_2.XComponent, YComponent=devec_2.YComponent, ZComponent=0)  # -> Vector, Length
move_5 = Move(Geometry=pl_origin, Motion=multiplication)  # -> Geometry, Transform
neg_3 = Negative(Value=X_5)
Y_3 = UnitY(Factor=division_5)
move_6 = Move(Geometry=pl_origin, Motion=neg_2)  # -> Geometry, Transform
move_7 = Move(Geometry=vec_3.Vector, Motion=vec.Vector)  # -> Geometry, Transform
pl_origin_5 = PlaneOrigin(Base=xz_2, Origin=move_7.Geometry)
prot = RotatePlane(Plane=pl_origin_2, Angle=1.570796327)
move_8 = Move(Geometry=vec_4.Vector, Motion=vec.Vector)  # -> Geometry, Transform
pl_origin_6 = PlaneOrigin(Base=xz_3, Origin=move_8.Geometry)
prot_2 = RotatePlane(Plane=move_5.Geometry, Angle=-1.570796327)
move_9 = Move(Geometry=pl_origin_3, Motion=neg_3)  # -> Geometry, Transform
prot_3 = RotatePlane(Plane=move_6.Geometry, Angle=1.570796327)
move_10 = Move(Geometry=pl_origin_4, Motion=X_6)  # -> Geometry, Transform
move_11 = Move(Geometry=prot, Motion=Y_3)  # -> Geometry, Transform
pflip = FlipPlane(Plane=move_9.Geometry, ReverseX=False, ReverseY=False, SwapAxes=True)

# ---- group: RH_OUT:D3_GRD_interface2
pln = Plane(prot_2)

# ---- group: RH_OUT:D3_GRD_interface1
pln_2 = Plane(prot_3)

# ----
pflip_2 = FlipPlane(Plane=move_10.Geometry, ReverseX=False, ReverseY=False, SwapAxes=True)
prot_4 = RotatePlane(Plane=pflip_2, Angle=1.570796327)

# ---- group: RH_OUT:D3_GRD_interface3
pln_3 = Plane(pl_origin_5)

# ----
prot_5 = RotatePlane(Plane=pflip, Angle=-1.570796327)

# ---- group: RH_OUT:D3_GRD_interface4
pln_4 = Plane(pl_origin_6)

# ---- group: RH_OUT:D3_GRD_interface7
pln_5 = Plane(move_11.Geometry)

# ----
deplane_2 = DeconstructPlane(Plane=pln)  # -> Origin, XAxis, YAxis, ZAxis

# ---- group: RH_OUT:D3_GRD_interface5
pln_6 = Plane(prot_4)

# ----
deplane_3 = DeconstructPlane(Plane=pln_2)  # -> Origin, XAxis, YAxis, ZAxis

# ---- group: RH_OUT:D3_GRD_interface6
pln_7 = Plane(prot_5)

# ----
deplane_4 = DeconstructPlane(Plane=pln_3)  # -> Origin, XAxis, YAxis, ZAxis
deplane_5 = DeconstructPlane(Plane=pln_4)  # -> Origin, XAxis, YAxis, ZAxis
deplane_6 = DeconstructPlane(Plane=pln_5)  # -> Origin, XAxis, YAxis, ZAxis
deplane_7 = DeconstructPlane(Plane=pln_7)  # -> Origin, XAxis, YAxis, ZAxis
vdis = VectorDisplay(Anchor=deplane_2.Origin, Vector=deplane_2.ZAxis)
deplane_8 = DeconstructPlane(Plane=pln_6)  # -> Origin, XAxis, YAxis, ZAxis
vdis_2 = VectorDisplay(Anchor=deplane_2.Origin, Vector=deplane_2.XAxis)
vdis_3 = VectorDisplay(Anchor=deplane_3.Origin, Vector=deplane_3.ZAxis)
vdis_4 = VectorDisplay(Anchor=deplane_3.Origin, Vector=deplane_3.XAxis)
vdis_5 = VectorDisplay(Anchor=deplane_4.Origin, Vector=deplane_4.ZAxis)
vdis_6 = VectorDisplay(Anchor=deplane_4.Origin, Vector=deplane_4.XAxis)
vdis_7 = VectorDisplay(Anchor=deplane_5.Origin, Vector=deplane_5.ZAxis)
vdis_8 = VectorDisplay(Anchor=deplane_5.Origin, Vector=deplane_5.XAxis)
vdis_9 = VectorDisplay(Anchor=deplane_6.Origin, Vector=deplane_6.ZAxis)
vdis_10 = VectorDisplay(Anchor=deplane_7.Origin, Vector=deplane_7.ZAxis)
vdis_11 = VectorDisplay(Anchor=deplane_6.Origin, Vector=deplane_6.XAxis)
vdis_12 = VectorDisplay(Anchor=deplane_7.Origin, Vector=deplane_7.XAxis)
vdis_13 = VectorDisplay(Anchor=deplane_8.Origin, Vector=deplane_8.ZAxis)
vdis_14 = VectorDisplay(Anchor=deplane_8.Origin, Vector=deplane_8.XAxis)
