# Grasshopper definition twisty.gh (Grasshopper 1.0.8)

circle = Circle({Plane=PlaneXY(0, 0, 0), Radius=5})
get_geometry = GetGeometry(AnnotationTypeFilter=0, AtLeast=1, AtMost=1, DeleteInput=False, Filter=1074004029, TreeAccess=False)
curve = GetGeometry(circle, AnnotationTypeFilter=0, AtLeast=1, AtMost=2147483647, DeleteInput=False, Filter=1073741828, TreeAccess=False)
rotate = GetNumber("110", AtLeast=1, AtMost=2147483647, Maximum=1.797693135e+308, Minimum=-1.797693135e+308, TreeAccess=False)
Z = UnitZ(Factor=Slider(14, range=0..100))
move = Move(Geometry=curve, Motion=Z)  # -> Geometry, Transform
rad = Radians(Degrees=rotate)
rotate_2 = Rotate(Geometry=move.Geometry, Angle=rad, Plane=PlaneXY(0, 0, 0))  # -> Geometry, Transform
divide = DivideCurve(Curve=curve, Count=10, Kinks=False)  # -> Points, Tangents, Parameters
divide_2 = DivideCurve(Curve=rotate_2.Geometry, Count=10, Kinks=False)  # -> Points, Tangents, Parameters
ln = Line(StartPoint=divide.Points, EndPoint=divide_2.Points)

# ---- group: RH_OUT:lines
crv = Curve(ln)
